# Grasshopper definition robotic_brick_laying.ghx (Grasshopper 1.0.7)

bricks = GhPythonScript()  # -> out, surfaces, brick_planes
# ---------- bricks: Python ----------
from compas_rhino import unload_modules
unload_modules('model')

from model import Wall
from model import Fabrication



myWall = Wall(10,50)
surfaces = myWall.geometric_model()
script = myWall.fabrication_model()

print script


#Fabrication Instructions
# ---------- end bricks ----------
geo = Geometry(bricks.surfaces)
pln = Plane(bricks.brick_planes)
